# Grasshopper definition SamplingData_001.gh (Grasshopper 1.0.7)
# plug-ins: Hops, Bifocals

# ----
# SamplingData_001 : ColorsNumber
# Python Code in VSC
panel = Panel("colors.txt")
samplingdata_001 = Hops(
    File=panel,
    CacheResultsInMemory=False,
    CacheSolveResults=False,
    RemoteDefinitionLocation="http://127.0.0.1:5000/ReadText",
    RemoteSolveVersion=(0, 1, 0),
    ShowInput_Enabled=False,
    ShowInput_Path=False,
    SynchronousSolve=True)
panel_2 = Panel(samplingdata_001)

# ----
# Node Script in Grasshopper
panel_3 = Panel("\")
text_split = TextSplit(Text=samplingdata_001, Separators=panel_3)
dispatch = Dispatch(List=text_split, DispatchPattern=[True, False])  # -> ListA, ListB
panel_4 = Panel(text_split)
panel_5 = Panel(dispatch.ListB)
replace_text = ReplaceText(Text=dispatch.ListB, Find="t", RecursiveReplace=False)
panel_6 = Panel(replace_text)
panel_7 = Panel(dispatch.ListA)
cull_index = CullIndex(List=flatten(dispatch.ListA), Indices="0", Wrap=True)
cull_index_2 = CullIndex(List=flatten(replace_text), Indices="0", Wrap=True)
panel_8 = Panel(cull_index)
panel_9 = Panel(cull_index_2)
construct_point = ConstructPoint(XCoordinate=panel_9, YCoordinate=0, ZCoordinate=0)
circle = Circle(Plane=construct_point, Radius=1)
colours = Colours(graft(panel_8))
boundary_surfaces = BoundarySurfaces(Edges=circle)
mesh_sphere = MeshSphere(Base=construct_point, Radius=Slider(0.544, range=0..1), UCount=10, VCount=20)
mesh_brep = MeshBrep(
    Brep=boundary_surfaces,
    Settings={GridMaxCount=0, GridMinCount=16, JaggedSeams=False, MaxEdgeLength=0, MinEdgeLength=0.0001, MinTolerance=0, Refine=True, RefineAngle=0, RelativeTolerance=0.65, SimplePlanes=True, Tolerance=0})
mesh_colours = MeshColours(Mesh=graft(mesh_sphere), Colours=colours)
mesh_colours_2 = MeshColours(Mesh=graft(mesh_brep), Colours=colours)
