# Grasshopper definition SamplingData_002.gh (Grasshopper 1.0.7)
# plug-ins: Bifocals, Hops

# ----
# SamplingData_002 : ColorsNumber
# Python Code in VSC
panel = Panel("colors.txt")
colorsnumber = Hops(
    File=panel,
    CacheResultsInMemory=False,
    CacheSolveResults=False,
    RemoteDefinitionLocation="http://127.0.0.1:5000/colorsNumber",
    RemoteSolveVersion=(0, 1, 0),
    ShowInput_Enabled=False,
    ShowInput_Path=False,
    SynchronousSolve=True)  # -> Colors, Numbers
panel_2 = Panel(colorsnumber.Numbers)
panel_3 = Panel(colorsnumber.Colors)

# ----
# Node Script in Grasshopper
construct_point = ConstructPoint(XCoordinate=panel_2, YCoordinate=0, ZCoordinate=0)
circle = Circle(Plane=construct_point, Radius=1)
colours = Colours(graft(panel_3))
boundary_surfaces = BoundarySurfaces(Edges=circle)
mesh_sphere = MeshSphere(Base=construct_point, Radius=Slider(0.52, range=0..1), UCount=10, VCount=20)
mesh_brep = MeshBrep(
    Brep=boundary_surfaces,
    Settings={GridMaxCount=0, GridMinCount=16, JaggedSeams=False, MaxEdgeLength=0, MinEdgeLength=0.0001, MinTolerance=0, Refine=True, RefineAngle=0, RelativeTolerance=0.65, SimplePlanes=True, Tolerance=0})
mesh_colours = MeshColours(Mesh=graft(mesh_sphere), Colours=colours)
mesh_colours_2 = MeshColours(Mesh=graft(mesh_brep), Colours=colours)
